# Grasshopper definition examples.gh (Grasshopper 1.0.8)
# plug-ins: Design Tools

number_slider = Slider(50, range=0..100)
toggle = BooleanToggle(True)  # disabled
swatch = ColourSwatch(SwatchColor=RGB(65, 65, 65))  # disabled
swatch_2 = ColourSwatch(SwatchColor=RGB(50, 50, 50))  # disabled
number_slider_2 = Slider(100, range=0..100)
srf = Surface(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)
canvas = CSharpScript(background=swatch_2, grid=swatch, switcher=toggle)  # inputs background: Color, grid: Color, switcher: Boolean; disabled
# ---------- canvas: C# usings ----------
using System.Drawing;
# ---------- canvas: C# ----------
    Component.Message = "Changes Canvas Colour";

    if (switcher == true)
    {
      Grasshopper.GUI.Canvas.GH_Skin.canvas_grid = grid;
      Grasshopper.GUI.Canvas.GH_Skin.canvas_back = background;
      Grasshopper.GUI.Canvas.GH_Skin.canvas_edge = Color.FromArgb(255, 0, 0, 0);
      Grasshopper.GUI.Canvas.GH_Skin.canvas_shade = Color.FromArgb(80, 0, 0, 0);
    }
    else
    {
      //DEFAULTS
      Grasshopper.GUI.Canvas.GH_Skin.canvas_grid = Color.FromArgb(30, 0, 0, 0);
      Grasshopper.GUI.Canvas.GH_Skin.canvas_back  = Color.FromArgb(255, 212, 208, 200);
      Grasshopper.GUI.Canvas.GH_Skin.canvas_edge = Color.FromArgb(255, 0, 0, 0);
      Grasshopper.GUI.Canvas.GH_Skin.canvas_shade = Color.FromArgb(80, 0, 0, 0);
    }
# ---------- end canvas ----------
resize = Resize(Geometry=srf, Y=Slider(100, range=0..200), align=False, match=True, union=False)  # -> Geometry, Planes, Scales, Moves, Notes
rectangle = Rectangle(X=number_slider, Y=number_slider, Radii=Slider(10, range=0..10), s=0)  # -> Curves, Joined, Points, Notes
rectangle_2 = Rectangle(X=number_slider_2, Y=number_slider_2, Radii=Slider(15, range=0..100), s=0)  # -> Curves, Joined, Points, Notes
neg = Negative(Value=Slider(12, range=0..200))
pt = ConstructPoint(XCoordinate=Slider(35, range=0..100), YCoordinate=0, ZCoordinate=Slider(15, range=0..100))
pt_2 = ConstructPoint(XCoordinate=Slider(25, range=0..100), YCoordinate=0, ZCoordinate=0)
pt_3 = ConstructPoint(XCoordinate=Slider(100, range=0..100), YCoordinate=0, ZCoordinate=Slider(20, range=0..100))
pt_4 = ConstructPoint(XCoordinate=0, YCoordinate=0, ZCoordinate=0)
pill = Pill(X=Slider(50, range=0..100), Y=Slider(80, range=0..100), p_width=False, smooth=True)  # -> Curves, Joined, Pivots
rectangle_3 = Rectangle(X=Slider(70, range=0..100), Y=Slider(130, range=0..1000), Radii=Slider(20, range=0..100), s=0)  # -> Curves, Joined, Points, Notes
pt_5 = ConstructPoint(XCoordinate=0, YCoordinate=0, ZCoordinate=Slider(46, range=0..100))
geo = Geometry([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])
geo_2 = Geometry([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])
pt_6 = ConstructPoint(XCoordinate=0, YCoordinate=0, ZCoordinate=neg)
extrude_indent = ExtrudeIndent(Curves=rectangle.Curves, Fillets=Slider(0.5, range=0..10), Extrude=Slider(50, range=0..100), Inset=0, Flip=False, s=0)  # -> Breps, Planes, EdgesA, EdgesB, Notes
pline = PolyLine(Vertices=[pt_4, pt_2, pt, pt_3], Closed=False)
Z = UnitZ(Factor=Slider(20, range=0..100))
move = Move(Geometry=resize.Geometry, Motion=pt_6)  # -> Geometry, Transform
sweep = Sweep(Rails=rectangle_3.Curves, Profile=geo_2, Sectors=15, cap=True)  # -> Breps, Curves, Notes
number_slider_3 = Slider(1.9, range=0..10)
move_2 = Move(Geometry=rectangle_2.Curves, Motion=pt_5)  # -> Geometry, Transform
xy = XYPlane(Origin=Z)
extend = Extend_Curve(Curve=pline, End=Slider(100, range=0..100), end_style=0, proportional=False, start_style=0)
number_slider_4 = Slider(20.2, range=0..100)
item = ListItem(List=sweep.Breps, Index=Slider(5, range=0..15), Wrap=True)  # -> Item, Item1, Item2, Item3, Item4
extrude_indent_2 = ExtrudeIndent(Curves=pill.Curves, Brep=move.Geometry, Fillets=Slider(1.8, range=0..3), Inset=0, Flip=False, s=4)  # -> Breps, Planes, EdgesA, EdgesB, Notes
number_slider_5 = Slider(25, range=0..100)
split_brep = SplitBrep(
    Brep=extrude_indent.Breps,
    Plane=xy,
    Fillet=Slider(0.1, range=0..1),
    Blend=0.68,
    Flip=Toggle(False),
    cap=True,
    match=False,
    s=4)  # -> Breps, Curves
split_brep_2 = SplitBrep(
    Brep=extrude_indent.Breps,
    Plane=xy,
    Fillet=Slider(0.1, range=0..1),
    Blend=0.68,
    Flip=Toggle(True),
    cap=True,
    match=False,
    s=4)  # -> Breps, Curves
fillet = FilletCurves(Curves=extend, Radii=Slider(5, range=0..10), all=False, bully=False, clean=False)  # -> Curves, Joined
geo_3 = Geometry(item.Item)
number_slider_6 = Slider(2, range=0..10)
text_style = TextStyle(
    Font="Barlow",
    TextCase=Slider(1, range=0..10),
    Height=Slider(1.5, range=0..10),
    HorizontalAlign=Slider(1, range=0..2),
    VerticalAlign=Slider(1, range=0..2))
locate = Locate(
    Geometry=geo_3,
    Position=Slider(6, range=0..15),
    InsetU=number_slider_4,
    InsetV=number_slider_4,
    OffsetW=Slider(5, range=0..10),
    box=True,
    simple=False)  # -> Plane, Surface, Edges, Body, Notes
rectangle_4 = Rectangle(X=number_slider_5, Y=number_slider_5, Radii=Slider(7.6, range=0..10), s=0)  # -> Curves, Joined, Points, Notes
locate_2 = Locate(Geometry=split_brep.Breps, InsetU=0, InsetV=0, OffsetW=0, box=True, simple=False)  # -> Plane, Surface, Edges, Body, Notes
number_slider_7 = Slider(6.1, range=0..100)
revolve = Revolve(Curves=fillet.Curves, centre=False, end_cap=False, start_cap=False)  # -> Revolve, Joined, BottomCircle
groove = Groove(
    Length=Slider(0, range=0..100),
    Radius=Slider(3, range=0..100),
    Depth=Slider(1.1, range=-3..3),
    Fillet=Slider(0.3, range=0..10),
    Blend=0.5,
    smooth=False)  # -> Brep, Curves, Profile
locate_3 = Locate(Geometry=split_brep_2.Breps, Face=Slider(16, range=0..20), InsetU=0, InsetV=0, OffsetW=0, box=False, simple=False)  # -> Plane, Surface, Edges, Body, Notes
extrude_indent_3 = ExtrudeIndent(Curves=move_2.Geometry, Brep=revolve.Joined, Fillets=Slider(1.9, range=0..10), Inset=0, Flip=Toggle(True), s=0)  # -> Breps, Planes, EdgesA, EdgesB, Notes
polygon = Polygon(Radius=5, Sides=5, Fillet=Slider(1.5, range=0..3), Blend=0.72, Match=False, s=0)  # -> Curves, Joined, Circle, Centres, Points
locate_4 = Locate(
    Geometry=extrude_indent_2.Breps,
    InsetU=0,
    InsetV=Slider(0, range=0..100),
    OffsetW=Slider(1, range=0..1),
    box=False,
    simple=False)  # -> Plane, Surface, Edges, Body, Notes
place = Place(Geometry=rectangle_4.Curves, Plane=locate.Plane)  # -> Geometry, Transform
locate_5 = Locate(
    Geometry=locate_3.Surface,
    Position=[Slider(0, range=0..10), Slider(2, range=0..10), Slider(6, range=0..10), Slider(8, range=0..10)],
    InsetU=number_slider_7,
    InsetV=number_slider_7,
    OffsetW=0,
    box=False,
    simple=False)  # -> Plane, Surface, Edges, Body, Notes
place_2 = Place(Geometry=groove.Curves, Plane=graft(locate_5.Plane))  # -> flatten(Geometry), Transform
text = Text(Text="Logo", Style=text_style)  # -> Curves, Hatches, Bounds
asterisk = Asterisk(Radius=Slider(5, range=0..10), Width=2, NumberOfArms=5, s=0)  # -> Curves, Joined, Points
place_3 = Place(Geometry=groove.Brep, Plane=locate_5.Plane)  # -> Geometry, Transform
number_slider_8 = Slider(2, range=0..10)
place_4 = Place(Geometry=polygon.Curves, Plane=locate_4.Plane)  # -> Geometry, Transform
number_slider_9 = Slider(0.2, range=0..1)
volcano_curved = CurvedVolcano(
    Brep=geo_3,
    Curves=place.Geometry,
    Offset=Slider(5, range=0..10),
    Fillet=Slider(0.4, range=0..10),
    Blend=0.68,
    cap=True,
    from_edge=False,
    s=3)  # -> Brep, Planes, TopCurves, MidCurves, BottomCurves, FilletCurves, SideCurves
cir = Circle(Plane=locate_2.Plane, Radius=Slider(20, range=0..100))
geo_4 = Geometry([item.Item1, item.Item2, item.Item3, item.Item4])
srfsplit = SurfaceSplit(Surface=locate_3.Surface, Curves=flatten(place_2.Geometry))
extrude_indent_4 = ExtrudeIndent(
    Curves=place_4.Geometry,
    Brep=extrude_indent_2.Breps,
    Fillets=Slider(0.1, range=0..0.1),
    Extrude=Slider(1, range=0..1),
    Inset=0,
    Flip=Toggle(False),
    s=0)  # -> Breps, Planes, EdgesA, EdgesB, Notes
geo_5 = Geometry(volcano_curved.TopCurves)
extrude_indent_5 = ExtrudeIndent(
    Curves=cir,
    Brep=split_brep.Breps,
    Fillets=number_slider_9,
    Extrude=number_slider_8,
    Inset=Slider(1, range=0..10),
    Flip=Toggle(True),
    s=0)  # -> Breps, Planes, EdgesA, EdgesB, Notes
extrude_indent_6 = ExtrudeIndent(Curves=cir, Brep=split_brep.Breps, Fillets=number_slider_9, Extrude=number_slider_8, Inset=0, Flip=False, s=0)  # -> Breps, Planes, EdgesA, EdgesB, Notes
resize_2 = Resize(Geometry=asterisk.Joined, Refs=text.Curves, X=Toggle(True), align=False, match=True, union=True)  # -> Geometry, Planes, Scales, Moves, Notes
size = SizeSelect(Geometry=srfsplit, s=0)  # -> Piece, Others
number_slider_10 = Slider(6.1, range=0..10)
distribute = Distribute(Geometry=flatten([text.Curves, asterisk.Joined]), Y=Slider(1.1, range=0..10), align=False, centre=0, order=True)  # -> Geometry, Moves, Notes
geo_6 = Geometry(size.Piece)
entwine = Entwine(Branch00=text.Curves, Branch01=resize_2.Geometry, FlattenInputs=True)
locate_6 = Locate(
    Geometry=extrude_indent_2.Breps,
    Face=Slider(3, range=0..10),
    InsetU=0,
    InsetV=Slider(0, range=0..100),
    OffsetW=0,
    box=False,
    simple=False)  # -> Plane, Surface, Edges, Body, Notes
locate_7 = Locate(Geometry=extrude_indent_6.Breps, Face=Slider(2, range=0..10), InsetU=0, InsetV=0, OffsetW=0, box=True, simple=False)  # -> Plane, Surface, Edges, Body, Notes
pill_2 = Pill(X=8.5, Y=2.5, p_width=False, smooth=False)  # -> Curves, Joined, Pivots
locate_8 = Locate(
    Geometry=geo_5,
    Position=[Slider(0, range=0..100), Slider(2, range=0..10), Slider(6, range=0..10), Slider(8, range=0..10)],
    InsetU=number_slider_10,
    InsetV=number_slider_10,
    OffsetW=0,
    box=True,
    simple=False)  # -> Plane, Surface, Edges, Body, Notes
distribute_2 = Distribute(Geometry=entwine, Y=Slider(1.1, range=0..10), align=False, centre=0, order=True)  # -> Geometry, Moves, Notes
join = BrepJoin(Breps=flatten([locate_3.Body, size.Piece, place_3.Geometry]))  # -> Breps, Closed
place_5 = Place(Geometry=pill_2.Curves, Plane=locate_6.Plane)  # -> Geometry, Transform
cylinder = Cylinder(
    TopAndBottomRadius=Slider(5, range=0..10),
    Height=Slider(1.2, range=0..10),
    Sections=1,
    Fillets=[Slider(0.33, range=0..1), Slider(0.05, range=0..1)],
    CapEnds=True,
    Centre=False,
    s=2)  # -> Brep, Profile, Circles, Arcs
surface = Surface(Curves=distribute_2.Geometry, s=0)
extrude_indent_7 = ExtrudeIndent(
    Curves=place_5.Geometry,
    Brep=extrude_indent_4.Breps,
    Fillets=Slider(0.1, range=0..0.1),
    Extrude=Slider(5.5, range=0..10),
    Inset=0,
    Flip=False,
    s=0)  # -> Breps, Planes, EdgesA, EdgesB, Notes
place_6 = Place(Geometry=cylinder.Brep, Plane=locate_8.Plane)  # -> Geometry, Transform
usb_c_connectors = Brep([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])
usb_c_tongue = Brep(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)
geo_7 = Geometry([volcano_curved.Brep, geo_4, place_6.Geometry])
place_7 = Place(Geometry=usb_c_tongue, Plane=extrude_indent_7.Planes)  # -> Geometry, Transform
place_8 = Place(Geometry=usb_c_connectors, Plane=extrude_indent_7.Planes)  # -> Geometry, Transform
place_9 = Place(Geometry=surface, Plane=locate_7.Plane)  # -> Geometry, Transform
geo_8 = Geometry([extrude_indent_7.Breps, place_7.Geometry, place_8.Geometry])
N = Nudge(Geometry=place_9.Geometry, AxisIdx=1, ValIdx=3)
upper = Geometry(extrude_indent_6.Breps)
logo = Geometry(N)
base = Geometry(join.Breps)
top = Geometry(extrude_indent_5.Breps)
